% Simulink data dictionary BMS_BusDef_DD.sldd

CntctCmd = Simulink.Bus()
  PosCntctChgrCmd: boolean
  PreChrgRelayChgrCmd: boolean
  NegCntctChgrCmd: boolean
  PosCntctInvtrCmd: boolean
  PreChrgRelayInvtrCmd: boolean
  NegCntctInvtrCmd: boolean

BMS_Cmd = Simulink.Bus()
  CurrentLimits_Bus: Bus: CurrentLimits
  ChargeCurrentReq: single, Unit="A"
  ContactorsCmd_Bus: Bus: CntctCmd
  BalCmd: boolean[1 96]

CurrentLimits = Simulink.Bus()
  DischargeCurrentLimit: single, Unit="A"
  ChargeCurrentLimit: single, Unit="A"

Sensors = Simulink.Bus()
  Cell_Voltages: single[96], Min=0, Max=5, Unit="V"
  Pack_Voltage: single, Min=0, Max=480, Unit="V"
  Pack_Current: single, Min=-250, Max=250, Unit="A"
  Cell_Temperatures: single[96], Min=-25, Max=80, Unit="C"
  Vout_Chgr: single, Min=-500, Max=500, Unit="V"
  Vout_Invtr: single, Min=-500, Max=500, Unit="V"

Faults = Simulink.Bus()
  PackOverCurrFlt: boolean
  CellHighTempFlt: boolean
  CellLowTempFlt: boolean
  VoltSensorFlt: boolean
  CellOverVoltFlt: boolean
  CellUnderVoltFlt: boolean
  ChrgCntctFlt: boolean
  InvtrCntctFlt: boolean

SOC_Est = Simulink.Bus()
  SOC_CC: single, Min=0, Max=1  % State of Charge Estimation based on Coulumb Counting
  SOC_EKF: single, Min=0, Max=1  % State of Charge Estimation based on Extended Kalman Filter

Min_Max_Cells = Simulink.Bus(HeaderFile="Rte_Type.h")
  MinCellVolt: single, Min=0, Max=5, Unit="V"
  MaxCellVolt: single, Min=0, Max=5, Unit="V"
  MinCellTemp: single, Min=-25, Max=80, Unit="C"
  MaxCellTemp: single, Min=-25, Max=80, Unit="C"

BMS_Info = Simulink.Bus()
  Faults_Bus: Bus: Faults
  BMS_State: Enum: BMS_State_Enum
  ChargeMode: Enum: ChargeMode_Enum
  SOC_Est: single