% Simulink data dictionary BMS_Software_DD.sldd
% references BMS_BusDef_DD.sldd
% references BMS_Config_DD.sldd
% references Shared_DD.sldd

PackOverCurrFlt = Simulink.Signal(StorageClass="ExportedGlobal", DataType="boolean", InitialValue="false")
CellHighTempFlt = Simulink.Signal(StorageClass="ExportedGlobal", DataType="boolean", InitialValue="false")
CellLowTempFlt = Simulink.Signal(StorageClass="ExportedGlobal", DataType="boolean", InitialValue="false")
VoltSensorFlt = Simulink.Signal(StorageClass="ExportedGlobal", DataType="boolean", InitialValue="false")
CellOverVoltFlt = Simulink.Signal(StorageClass="ExportedGlobal", DataType="boolean", InitialValue="false")
CellUnderVoltFlt = Simulink.Signal(StorageClass="ExportedGlobal", DataType="boolean", InitialValue="false")
ChrgCntctFlt = Simulink.Signal(StorageClass="ExportedGlobal", DataType="boolean", InitialValue="false")
InvtrCntctFlt = Simulink.Signal(StorageClass="ExportedGlobal", DataType="boolean", InitialValue="false")
MaxChrgCurrLimit = Simulink.Parameter(3.3, StorageClass="ExportedGlobal", DataType="single", Unit="A")
OverCellVoltageLimit = Simulink.Parameter(4.25, StorageClass="ExportedGlobal", DataType="single", Unit="V")  % Maximum Cell Voltage Limit to Trigger Fault
UnderCellVoltageLimit = Simulink.Parameter(2.5, StorageClass="ExportedGlobal", DataType="single", Unit="V")  % Minimum Cell Voltage Limit to Trigger Fault
LowCellTempLimit = Simulink.Parameter(-15, StorageClass="ExportedGlobal", DataType="single", Unit=" degC")  % Low Cell Temperature Limit to Trigger Fault
HighCellTempLimit = Simulink.Parameter(55, StorageClass="ExportedGlobal", DataType="single", Unit=" degC")  % High Cell Temperature Limit to Trigger Fault
BalNotActWait = int16(30)
BalOffWait = int16(20)
BalOnWait = int16(60)
TargetDeltaV = single(0.01)
flgEnBalancing = true
voltThreshold = single(4.1)
noCurrent = single(0)
CV_Gain = single(0.5)
MaxCellVoltThrsld = single(4.15)
currentFactor = single(20)
MinCellVoltDchrgCurrentLim = Simulink.Signal(StorageClass="ExportedGlobal", DataType="single")
LowTempDchrgCurrentLim = Simulink.Signal(StorageClass="ExportedGlobal", DataType="single")
HighTempDchrgCurrentLim = Simulink.Signal(StorageClass="ExportedGlobal", DataType="single")
MinCellVolt = Simulink.Signal(StorageClass="ExportedGlobal", DataType="single", Min=0, Max=5, Unit="V")
MaxCellVolt = Simulink.Signal(StorageClass="ExportedGlobal", DataType="single", Min=0, Max=5, Unit="V")
MaxCellTemp = Simulink.Signal(StorageClass="ExportedGlobal", DataType="single", Min=-25, Max=80, Unit="C")
MinCellTemp = Simulink.Signal(StorageClass="ExportedGlobal", DataType="single", Min=-25, Max=80, Unit="C")
MinMaxCells = Simulink.Signal(StorageClass="ExportedGlobal", DataType="Bus: Min_Max_Cells")
MaxCellVoltChrgCurrentLim = Simulink.Signal(StorageClass="ExportedGlobal", DataType="single")
LowTempChrgCurrentLim = Simulink.Signal(StorageClass="ExportedGlobal", DataType="single")
HighTempChrgCurrentLim = Simulink.Signal(StorageClass="ExportedGlobal", DataType="single")

MinCellVoltDchrgCurrentLimTable = Simulink.LookupTable(
  Table=Simulink.lookuptable.Table(
    Description="Discharge Current Rate Based On Mim Cell Voltage",
    Value=single([0 0.5 1]),
    Dimensions=[1 3],
    DataType="single",
    FieldName="DischargeCurrentRate"),
  BreakpointsSpecification="Explicit values",
  Breakpoints=Simulink.lookuptable.Breakpoint(
    Description="Minimum Cell Voltage",
    Value=[2.5; 2.75; 3],
    TunableSizeName="N1",
    Dimensions=[3 1],
    DataType="single",
    Unit="V",
    FieldName="MinCellVoltage"),
  AllowMultipleInstancesOfTypeToHaveDifferentTableBreakpointSizes=false)

CntctWaitTime = uint16(200)
PreChrgTimeOut = uint8(1)
PreChrgVoltRatio = single(0.95)
Ts = 0.1
movAvgWin = 4000
X_MAX = [4.232073; 5.99961; 26.28963]
X_MIN = [2.796455; -18.09715; -10.30473]
SOCInit = 0.75

Contact = enum(DefaultValue="Open", StorageType="int8")
  Init = 0
  Open = 1
  Close = 2
  Fault = 3

MaxDchrgCurrLimit = Simulink.Parameter(-12, StorageClass="ExportedGlobal", DataType="single", Unit="A")
MaxSprtDchrgCurrLimit = Simulink.Parameter(-17, StorageClass="ExportedGlobal", DataType="single", Unit="A")