% Simulink data dictionary Shared_DD.sldd

ts = 0.1

Battery = struct(
  SOC_LUT=[0.01 0.02 0.03 0.04 0.05 0.06 0.07 0.08 0.09 0.1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 1],
  Temperature_LUT=[-10 0 25 40],
  Capacity_LUT=[2.68 2.78 3.18 3.14],
  Em_LUT=[2.673081 2.699838 3.011622 2.862402
   2.744117 2.777096 3.085757 3.103685
   2.804086 2.854582 3.141775 3.250347
   2.862477 2.919469 3.186318 3.348554
   2.908511 2.974179 3.22335 3.430648
   2.949043 3.020006 3.253901 3.421855
   2.982985 3.059291 3.278789 3.43051
   3.014671 3.094965 3.300704 3.440713
   3.040315 3.126745 3.321185 3.432675
   3.062568 3.157189 3.338732 3.430259
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   ],
  R0_LUT=[0.05690268 0.06291642 0.1083836 0.1085269
   0.05755069 0.06271853 0.1042765 0.1176751
   0.05767309 0.062749 0.09750736 0.1232357
   0.05756274 0.06274179 0.09375013 0.1269592
   0.05737873 0.06300545 0.08938195 0.1300718
   0.05719311 0.06295343 0.08546447 0.1176045
   0.05682 0.06228194 0.08175755 0.1098617
   0.05641193 0.06167138 0.07896572 0.1026883
   0.05619743 0.06116047 0.07637004 0.09519208
   0.05608056 0.06063949 0.07435001 0.0894406
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   ],
  R1_LUT=repmat(0.0035, 100, 4),
  C1_LUT=repmat(5000, 100, 4),
  Mass=0.047,
  ThermalMass=44,
  R_bleed=20,
  h_conv=5,
  cell_area=0.0037,
  TempInit=25,
  SOCInit=0.75,
  Model="panasonic ncr18650bd",
  DischargeCycle_LUT=[1 5 9 13 17 21 25 29 33 37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 317],
  deltaEm_LUT=[0 -0.3631156 -0.6000966 -0.68907 -0.7677338 -0.8463976 -0.9263684 -0.9927113 -1.05705 -1.122277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 -3.706745],
  deltaCapacity_LUT=[0 -0.8600191 -1.713324 -2.08194 -2.450556 -2.819172 -3.187787 -3.488849 -3.780815 -4.07278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 -13.30728])

BatteryNN = struct(
  SOC_vec=[0; 0.1; 0.2; 0.3; 0.4; 0.5; 0.6; 0.7; 0.8; 0.9; 1],
  T_vec=[253.15 263.15 273.15 283.15 298.15 313.15],
  AH=repmat(3, 1, 6),
  V0_mat=[1.471962 1.17056 1.972443 1.398841 2.447626 2.202431
   2.380026 2.485242 2.816572 2.794113 3.280015 3.162995
   3.251924 3.369023 3.401211 3.40776 3.477555 3.455376
   3.504286 3.510463 3.518309 3.537896 3.562188 3.552881
   3.595253 3.606702 3.598202 3.623083 3.647843 3.636326
   3.683792 3.680243 3.67719 3.685861 3.72751 3.711786
   3.776126 3.796533 3.781789 3.797116 3.835121 3.803923
   3.881924 3.888827 3.875023 3.899117 3.920594 3.90089
   3.984092 3.987494 3.986391 3.992963 4.014138 3.998957
   4.076008 4.075384 4.065285 4.069273 4.086793 4.075473
   4.119854 4.161177 4.140516 4.16349 4.181826 4.157045],
  R0_mat=[0.3185125 0.2780749 0.1363052 0.09763589 0.07768716 0.07022368
   0.2819755 0.2163331 0.109268 0.07143903 0.0539069 0.04984501
   0.2454385 0.1545914 0.08223073 0.04524218 0.03299956 0.02992672
   0.2089014 0.09284958 0.05554696 0.03832103 0.02676865 0.02457813
   0.1733372 0.08613458 0.05299657 0.03713753 0.02565175 0.02139272
   0.177829 0.08926015 0.05328457 0.03601116 0.02881886 0.02512463
   0.1760207 0.08543414 0.05360722 0.03774101 0.02980957 0.02266258
   0.1788604 0.09210846 0.05677335 0.04021896 0.03296999 0.02720731
   0.1948125 0.1000803 0.05996225 0.04194721 0.02967007 0.02678561
   0.2430623 0.1172748 0.06366871 0.04436829 0.03067274 0.02562338
   0.4053579 0.1893636 0.09216182 0.0619174 0.03528211 0.02807986],
  T_init=293.15,
  SOC0=1)

ModuleType1 = struct(
  SOC_vecCell=[0.01 0.02 0.03 0.04 0.05 0.06 0.07 0.08 0.09 0.1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 1],
  T_vecCell=[263.15 273.15 298.15 313.15],
  V0_matCell=[2.673081 2.699838 3.011622 2.862402
   2.744117 2.777096 3.085757 3.103685
   2.804086 2.854582 3.141775 3.250347
   2.862477 2.919469 3.186318 3.348554
   2.908511 2.974179 3.22335 3.430648
   2.949043 3.020006 3.253901 3.421855
   2.982985 3.059291 3.278789 3.43051
   3.014671 3.094965 3.300704 3.440713
   3.040315 3.126745 3.321185 3.432675
   3.062568 3.157189 3.338732 3.430259
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   ],
  V_rangeCell=[0 5],
  R0_matCell=[0.05690268 0.06291642 0.1083836 0.1085269
   0.05755069 0.06271853 0.1042765 0.1176751
   0.05767309 0.062749 0.09750736 0.1232357
   0.05756274 0.06274179 0.09375013 0.1269592
   0.05737873 0.06300545 0.08938195 0.1300718
   0.05719311 0.06295343 0.08546447 0.1176045
   0.05682 0.06228194 0.08175755 0.1098617
   0.05641193 0.06167138 0.07896572 0.1026883
   0.05619743 0.06116047 0.07637004 0.09519208
   0.05608056 0.06063949 0.07435001 0.0894406
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   ],
  AHCell=[2.68 2.78 3.18 3.14],
  thermal_massCell=44,
  CoolantResistance=0.005,
  CellBalancingClosedResistance=0.01,
  CellBalancingOpenConductance=1.0e-8,
  CellBalancingThreshold=0.5,
  CellBalancingResistance=10)

ParallelAssemblyType1 = struct(
  SOC_vecCell=[0.01 0.02 0.03 0.04 0.05 0.06 0.07 0.08 0.09 0.1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 1],
  T_vecCell=[263.15 273.15 298.15 313.15],
  V0_matCell=[2.673081 2.699838 3.011622 2.862402
   2.744117 2.777096 3.085757 3.103685
   2.804086 2.854582 3.141775 3.250347
   2.862477 2.919469 3.186318 3.348554
   2.908511 2.974179 3.22335 3.430648
   2.949043 3.020006 3.253901 3.421855
   2.982985 3.059291 3.278789 3.43051
   3.014671 3.094965 3.300704 3.440713
   3.040315 3.126745 3.321185 3.432675
   3.062568 3.157189 3.338732 3.430259
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   ],
  V_rangeCell=[0 5],
  R0_matCell=[0.05690268 0.06291642 0.1083836 0.1085269
   0.05755069 0.06271853 0.1042765 0.1176751
   0.05767309 0.062749 0.09750736 0.1232357
   0.05756274 0.06274179 0.09375013 0.1269592
   0.05737873 0.06300545 0.08938195 0.1300718
   0.05719311 0.06295343 0.08546447 0.1176045
   0.05682 0.06228194 0.08175755 0.1098617
   0.05641193 0.06167138 0.07896572 0.1026883
   0.05619743 0.06116047 0.07637004 0.09519208
   0.05608056 0.06063949 0.07435001 0.0894406
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   ],
  AHCell=[2.68 2.78 3.18 3.14],
  thermal_massCell=44,
  CoolantResistance=0.005,
  CellBalancingClosedResistance=0.01,
  CellBalancingOpenConductance=1.0e-8,
  CellBalancingThreshold=0.5,
  CellBalancingResistance=10)

ModuleAssembly1 = struct(
  Module1=struct(
    iCell=repmat(0, 6, 1),
    vCell=repmat(0, 6, 1),
    socCell=repmat(0.75, 6, 1),
    numCyclesCell=repmat(0, 6, 1),
    temperatureCell=repmat(298.15, 6, 1),
    vParallelAssembly=repmat(0, 6, 1),
    socParallelAssembly=repmat(1, 6, 1)),
  Module2=struct(
    iCell=repmat(0, 6, 1),
    vCell=repmat(0, 6, 1),
    socCell=repmat(0.75, 6, 1),
    numCyclesCell=repmat(0, 6, 1),
    temperatureCell=repmat(298.15, 6, 1),
    vParallelAssembly=repmat(0, 6, 1),
    socParallelAssembly=repmat(1, 6, 1)),
  Module3=struct(
    iCell=repmat(0, 6, 1),
    vCell=repmat(0, 6, 1),
    socCell=repmat(0.75, 6, 1),
    numCyclesCell=repmat(0, 6, 1),
    temperatureCell=repmat(298.15, 6, 1),
    vParallelAssembly=repmat(0, 6, 1),
    socParallelAssembly=repmat(1, 6, 1)),
  Module4=struct(
    iCell=repmat(0, 6, 1),
    vCell=repmat(0, 6, 1),
    socCell=repmat(0.75, 6, 1),
    numCyclesCell=repmat(0, 6, 1),
    temperatureCell=repmat(298.15, 6, 1),
    vParallelAssembly=repmat(0, 6, 1),
    socParallelAssembly=repmat(1, 6, 1)))

ModuleAssembly2 = struct(
  Module1=struct(
    iCell=repmat(0, 6, 1),
    vCell=repmat(0, 6, 1),
    socCell=repmat(0.75, 6, 1),
    numCyclesCell=repmat(0, 6, 1),
    temperatureCell=repmat(298.15, 6, 1),
    vParallelAssembly=repmat(0, 6, 1),
    socParallelAssembly=repmat(1, 6, 1)),
  Module2=struct(
    iCell=repmat(0, 6, 1),
    vCell=repmat(0, 6, 1),
    socCell=repmat(0.75, 6, 1),
    numCyclesCell=repmat(0, 6, 1),
    temperatureCell=repmat(298.15, 6, 1),
    vParallelAssembly=repmat(0, 6, 1),
    socParallelAssembly=repmat(1, 6, 1)),
  Module3=struct(
    iCell=repmat(0, 6, 1),
    vCell=repmat(0, 6, 1),
    socCell=repmat(0.75, 6, 1),
    numCyclesCell=repmat(0, 6, 1),
    temperatureCell=repmat(298.15, 6, 1),
    vParallelAssembly=repmat(0, 6, 1),
    socParallelAssembly=repmat(1, 6, 1)),
  Module4=struct(
    iCell=repmat(0, 6, 1),
    vCell=repmat(0, 6, 1),
    socCell=repmat(0.75, 6, 1),
    numCyclesCell=repmat(0, 6, 1),
    temperatureCell=repmat(298.15, 6, 1),
    vParallelAssembly=repmat(0, 6, 1),
    socParallelAssembly=repmat(1, 6, 1)))

ModuleAssembly3 = struct(
  Module1=struct(
    iCell=repmat(0, 6, 1),
    vCell=repmat(0, 6, 1),
    socCell=repmat(0.75, 6, 1),
    numCyclesCell=repmat(0, 6, 1),
    temperatureCell=repmat(298.15, 6, 1),
    vParallelAssembly=repmat(0, 6, 1),
    socParallelAssembly=repmat(1, 6, 1)),
  Module2=struct(
    iCell=repmat(0, 6, 1),
    vCell=repmat(0, 6, 1),
    socCell=repmat(0.75, 6, 1),
    numCyclesCell=repmat(0, 6, 1),
    temperatureCell=repmat(298.15, 6, 1),
    vParallelAssembly=repmat(0, 6, 1),
    socParallelAssembly=repmat(1, 6, 1)),
  Module3=struct(
    iCell=repmat(0, 6, 1),
    vCell=repmat(0, 6, 1),
    socCell=repmat(0.75, 6, 1),
    numCyclesCell=repmat(0, 6, 1),
    temperatureCell=repmat(298.15, 6, 1),
    vParallelAssembly=repmat(0, 6, 1),
    socParallelAssembly=repmat(1, 6, 1)),
  Module4=struct(
    iCell=repmat(0, 6, 1),
    vCell=repmat(0, 6, 1),
    socCell=repmat(0.75, 6, 1),
    numCyclesCell=repmat(0, 6, 1),
    temperatureCell=repmat(298.15, 6, 1),
    vParallelAssembly=repmat(0, 6, 1),
    socParallelAssembly=repmat(1, 6, 1)))

ModuleAssembly4 = struct(
  Module1=struct(
    iCell=repmat(0, 6, 1),
    vCell=repmat(0, 6, 1),
    socCell=repmat(0.75, 6, 1),
    numCyclesCell=repmat(0, 6, 1),
    temperatureCell=repmat(298.15, 6, 1),
    vParallelAssembly=repmat(0, 6, 1),
    socParallelAssembly=repmat(1, 6, 1)),
  Module2=struct(
    iCell=repmat(0, 6, 1),
    vCell=repmat(0, 6, 1),
    socCell=repmat(0.75, 6, 1),
    numCyclesCell=repmat(0, 6, 1),
    temperatureCell=repmat(298.15, 6, 1),
    vParallelAssembly=repmat(0, 6, 1),
    socParallelAssembly=repmat(1, 6, 1)),
  Module3=struct(
    iCell=repmat(0, 6, 1),
    vCell=repmat(0, 6, 1),
    socCell=repmat(0.75, 6, 1),
    numCyclesCell=repmat(0, 6, 1),
    temperatureCell=repmat(298.15, 6, 1),
    vParallelAssembly=repmat(0, 6, 1),
    socParallelAssembly=repmat(1, 6, 1)),
  Module4=struct(
    iCell=repmat(0, 6, 1),
    vCell=repmat(0, 6, 1),
    socCell=repmat(0.75, 6, 1),
    numCyclesCell=repmat(0, 6, 1),
    temperatureCell=repmat(298.15, 6, 1),
    vParallelAssembly=repmat(0, 6, 1),
    socParallelAssembly=repmat(1, 6, 1)))

PlntBattNumCellSer = 96
PlntBattNumCellPar = 31

SRE = enum(DefaultValue="Standby")  % User State Request
  Standby = 0  % Standby or Inactive Operational State
  Charging = 1  % Charging State
  Driving = 2  % Driving State
  SportMode = 3  % Driving State w higher current