% Simulink data dictionary Driver.sldd

DriverAeroRes = 0.5
DriverInitialGear = 0
DriverShiftTime = 0.1
DriverWheelRange = 1.047198
DriverPositionGainR = 0.25
DriverDelayGain = 0.01
DriverPreviewDist = 6.5
DriverFrontCornerStiff = 40000
DriverRearCornerStiff = 40000
DriverTimeConst = 0.1
DriverYawRateGain = 0.2
DriverPositionGainF = 6
DriverTractiveForce = 8000
DriverDrivelineRes = 10
DriverRollRes = 800