% Simulink data dictionary ElectricMachine1.sldd

PlntEM1TimeCnst = 0.02
PlntEM1TrqEff = [0 20 40 60 80 100 120 140 160 180 200]

PlntEM1EffTbl = [52 78 80 82 82 80 78 78 76 74 70
 52 78 80 82 82 80 78 78 76 74 70
 52 78 84 86 86 86 86 84 84 82 82
 52 80 86 86 88 88 88 86 86 84 84
 52 80 86 88 88 88 88 88 86 86 86
 52 80 86 88 90 90 90 90 88 88 88
 52 82 88 90 91 91 92 92 92 91 91
 52 82 88 91 91 92 93 93 93 93 93
 52 84 90 92 92 93 93 93 93 93 93
 62 86 91 93 93 93 93 93 93 93 93
 66 86 91 93 93 93 93 93 93 93 93
 70 86 92 93 93 93 93 93 93 93 93
 70 86 92 93 93 93 93 93 93 93 93
 72 86 91 93 93 93 93 93 93 93 93]

PlntEM1ExtSplySerRes = 0
PlntEM1RotDamp = 0.001
PlntEM1RotInertia = 0.01
PlntEM1RotInitSpd = 0
PlntEM1Trq = [200 200 200 200 200 200 200 181.8 155.9 136.4 121.2 109.1 99.2 90.9]
PlntEM1Spd = [0 119.1624 238.3247 357.4871 476.6494 595.8118 649.9955 714.9741 834.1365 953.2988 1072.4612 1191.6235 1310.7859 1429.9483]
PlntEM1SpdEff = [0 119.1624 238.3247 357.4871 476.6494 595.8118 649.9955 714.9741 834.1365 953.2988 1072.4612 1191.6235 1310.7859 1429.9483]