% Simulink data dictionary HevIpsVCU.sldd

CtrlVcuHevIpsEngPwr = [8377.58 15052.63 19736.84 24421.05 29105.26 33789.47 38473.68 43157.89 47842.11 52526.32 57210.53 61894.74 66578.95 71263.16 75947.37 80631.58 85315.79 90000]
CtrlVcuHevIpsEngSpd = [1000 1448.849 1712.991 1980.336 2249.116 2517.56 2783.899 3046.364 3303.185 3552.592 3792.817 4022.089 4238.64 4440.699 4626.498 4794.266 4942.234 5068.633]
CtrlVcuHevIpsEngTrq = [80 99.21122 110.0257 117.7598 123.5751 128.1661 131.972 135.2851 138.3085 141.1897 144.0408 146.9513 149.9967 153.2446 156.7587 160.6033 164.8457 169.5599]
CtrlVcuHevIpsEngTrqWhl = [87.79083 126.1059 164.4209 193.8434 202.7359 240.7508 272.1974 292.7217 307.1178 318.9242 329.429 339.9505 351.8001 366.6191 388.2845 404.7501]
CtrlVcuHevIpsEVSpdLmt = 16

CtrlVcuHevIpsGenMapEff = [60 60 60 60 60 65 60 60 60 60 60 60 60 60 60
 60 78 85 87 88 89 91 91 93 92 92 93 91 90 85
 60 82 88 90 90.5 92.5 94.5 95 95 94.5 93.5 93 93 93 93
 60 82 89 91 91.5 93.5 95 95 94.5 94 93 93 93 93 93
 60 82 88 91 92 94 95 94 94 93 93 93 93 93 93
 60 80 88 90.5 91.5 94 94.5 94 93 93 93 93 93 93 93
 60 78 87 90 90.5 93 94 93 93 93 93 93 93 93 93
 60 75 86 89 90 92 92 92 92 92 92 92 92 92 92
 60 74 84 87.5 89 91 91 91 91 91 91 91 91 91 91
 60 70 81 86 88 88 88 88 88 88 88 88 88 88 88
 60 66 79 86 88 88 88 88 88 88 88 88 88 88 88
 60 66 79 86 88 88 88 88 88 88 88 88 88 88 88]

CtrlVcuHevIpsGenMapSpdIndex = [0 1000 2000 2767.91 3000 4000 5000 6000 7000 8000 9000 10000 11000 12000 13000]
CtrlVcuHevIpsGenMapTrqIndex = [0 14 28 42 56 70 84 98 112 126 140 144.9]
CtrlVcuHevIpsGenPwrMax = 42000
CtrlVcuHevIpsGenSpd = [0 1000 2000 2767.91 3000 4000 5000 6000 7000 8000 9000 10000 11000 12000 13000 13500]
CtrlVcuHevIpsGenTrq = [144.9 144.9 144.9 144.9 133.6902 100.26761416 80.2140913 66.845076102 57.29578 50.133807073 44.563384068 40.107045657 36.46095 33.422538051 30.851573585 29.708922712]
CtrlVcuHevIpsGenTrqMax = 144.9
CtrlVcuHevIpsMotPwr = [0 21676.99 43353.98 59999.96 60000 60000 60000 60000 60000 60000 60000 60000 60000 60000 60000 60000]
CtrlVcuHevIpsN_idle = 750
CtrlVcuHevIpsNsysWhl = [0 116.077 232.1541 321.2908 348.2311 464.3081 580.3851 696.4622 812.5392 928.6162 1044.693 1160.77 1276.847 1392.924 1509.001 1567.04]
CtrlVcuHevIpsSOCChrgFactor = [84000 8400]
CtrlVcuHevIpsSOCmin = 50
CtrlVcuHevIpsSOCtarget = 60
CtrlVcuHevIpsSysTrqWhl = [1783.299 1783.299 1783.299 1783.299 1783.299 1474.754 1259.4 1115.391 1012.263 935.9259 877.875 833.5518 800.5286 777.9536 767.9778 770.3807]
CtrlVcuHevIpsBattDischrgPwrMax = 28000
CtrlVcuHevIpsBattChrgPwrMax = -28000
CtrlVcuHevIpsChrgLmtBpt = [1 1 1 1 1 1 1 1 0.7 0.35 0]
CtrlVcuHevIpsDischrgLmtBpt = [0 0.35 0.7 1 1 1 1 1 1 1 1]
CtrlVcuHevIpsRegenBrkSpdBpt = [5 9]
CtrlVcuHevIpsRegenBrkCutOff = [0 1]
CtrlVcuHevIpsSocBpt = [0 10 20 30 40 50 60 70 80 90 100]