% Simulink data dictionary VirtualVehicleTemplate.sldd
% references SiMappedEngine.sldd
% references SiEngine.sldd
% references SiEngineCore.sldd
% references SiEngineCoreV.sldd
% references SiEngineCoreNA.sldd
% references SiDLEngine.sldd
% references SimpleEngine.sldd
% references CiEngineCore.sldd
% references CiMappedEngine.sldd
% references SiEngineController.sldd
% references CiEngineController.sldd
% references BatteryDCDC.sldd
% references Drivetrain.sldd
% references ElectricMachine1.sldd
% references ElectricMachine2.sldd
% references FuelCellElectricSystem.sldd
% references PassVeh.sldd
% references Trailer.sldd
% references HevPxVCU.sldd
% references HevIpsVCU.sldd
% references HevMmVCU.sldd
% references VehicleConfig.sldd
% references Driver.sldd
% references Environment.sldd
% references Scenario.sldd
% references EvVCU.sldd
% references SiDynoReferenceApplication.sldd
% references ElectricMachine3.sldd
% references ElectricMachine4.sldd
% references ElectricalCoolingSystem.sldd

ScnFHSteerAmp = 540
PlntSpKCRollCamber = [0 0]
PlntSpKCRollCaster = [0 0]
PlntSpKCRollSteer = [0 0]
PlntSpKCRollStiffArbFrnt = 0
PlntSpKCRollStiffNoArbFrnt = 0
PlntSpKCRollStiffNoTwstRear = 0
VisScopeType = 1
VisXYPlotter = 1
PlntSpKCVrtLdTrnsfr = [0 0 0 0]
CtrlBcuTrlrBrkGain = Simulink.Parameter(0)
PlntEM1TrqLossTbl = repmat(0, 14, 11)
RegenEnd = 9
RegenStrt = 5
DriveCycleChoice = 4
RegenSprtStrt = 2.5

DriverMode = enum(DefaultValue="Comfort")
  Comfort = 0
  SportPlus = 1